# Grasshopper definition rhinoPreview.gh (Grasshopper 0.9.75)
# plug-ins: Python Interpreter

panel = Panel("C:\Users\Matthias\workspace\venice\coreFunctionality\eStats.csv")
timer = Timer(TimerInterval=200, Target=python)

# ----
# variables
axescount = Panel("3")
emittercount = Panel("""11
11
11""")
axesspacing = Panel("1828.8")
emitterwidth = Panel("234.95")
axesheight = Panel("3500")
emittermaxpan = Panel("3500")
masterrange = Panel("3.5")
emittermaxpan_2 = Number(emittermaxpan)
emitterwidth_2 = Number(emitterwidth)
emittercount_2 = Number(emittercount)
masterrange_2 = Number(masterrange)
axesspacing_2 = Number(axesspacing)
axesheight_2 = Number(axesheight)
axescount_2 = Number(axescount)

python = PythonScript(x=panel)  # -> out, a
# ---------- python: Python ----------
import rhinoscriptsyntax as rs

import Rhino.Geometry as rg
from clr import AddReference as addr
addr("Grasshopper")

from System import Object
from Grasshopper import DataTree
from Grasshopper.Kernel.Data import GH_Path


def raggedListToDataTree(raggedList):
    rl = raggedList
    result = DataTree[object]()
    for i in range(len(rl)):
        temp = []
        for j in range(len(rl[i])):
            temp.append(rl[i][j])
        #print i, " - ",temp
        path = GH_Path(i)
        result.AddRange(temp, path)
    return result


try:
    csvFile = open(x, 'r')
except:
    print "error"
else:
    lineList = csvFile.read().splitlines()

    itemList = [x.split(',') for x in lineList]

    a = raggedListToDataTree(itemList)
# ---------- end python ----------
panel_2 = Panel(python.a)
panel_3 = Panel(python.out)

# ----
# preview
emitterwidth_3 = Number(emitterwidth_2)
emittercount_3 = Number(emittercount_2)
axesspacing_3 = Number(axesspacing_2)
anglesindeg = Number(panel_2)
axesheight_3 = Number(axesheight_2)
axescount_3 = Number(axescount_2)
Y = UnitY(Factor=1)
neg = Negative(Value=emitterwidth_3)
Z = UnitZ(Factor=neg)
division = Division(A=emitterwidth_3, B="2")
neg_2 = Negative(Value=division)
multiplication = Multiplication(A=Z, B="10")
dom = ConstructDomain(DomainStart=neg_2, DomainEnd=division)

neg_3 = Negative(Value=anglesindeg)

# ----
# emitter centers
panel_4 = Panel("0")
series = Series(Start=panel_4, Step=axesspacing_3, Count=axescount_3)  # -> graft(Series)
series_2 = Series(Start="0", Step=emitterwidth_3, Count=emittercount_3)
pt = ConstructPoint(XCoordinate=series, YCoordinate=series_2, ZCoordinate=axesheight_3)

rad = Radians(Degrees=neg_3)
addition = Addition(A=pt, B=Z)
xy = XYPlane(Origin=addition)
addition_2 = Addition(A=pt, B=multiplication)
rectangle = Rectangle(Plane=xy, XSize=dom, YSize=dom, Radius=0)  # -> Rectangle, Length
ln = Line(StartPoint=pt, EndPoint=addition_2)
rot3d = Rotate3D(Geometry=rectangle.Rectangle, Angle=rad, Center=pt, Axis=Y)  # -> Geometry, Transform
rot3d_2 = Rotate3D(Geometry=ln, Angle=rad, Center=pt, Axis=Y)  # -> Geometry, Transform
emitterrectangles = Geometry(rot3d.Geometry)
emitterrays = Geometry(rot3d_2.Geometry)
